# Grasshopper definition line_model.ghx (Grasshopper 1.0.8)
# plug-ins: Human

range = Range(Domain=Domain(0, 1), Steps=Slider(4, range=0..10))
graph_mapper = GraphMapper(
    range,
    x0=0,
    x1=1,
    y0=0,
    y1=1,
    container_name="Bezier",
    cpx=[0, 0.6170566082, 0.8717642426, 1],
    cpy=[0, 0.0728777647, 0.464922905, 1])

# ----
# create and manipulate graph
curve = Curve(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)
brep = Brep(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)
point = Point([Point(163.5542514, 48.10027414, 15.94000248), Point(163.5542514, 57.72031214, 15.94000382), Point(173.1742514, 57.7202747, 19.94), Point(173.1742514, 48.1002747, 19.94)])
python_3_script = Python3Script(boundary=curve, roof_brep=brep, supports=point, z_steps=graph_mapper)  # -> out, ridges_tree, all_edges, graph, all_nodes, node_keys; inputs boundary: Curve, roof_brep: Brep, supports: list of Point3d, z_steps: list of Double
# ---------- python_3_script: Python ----------
import os
import sys
from compas_rhino import unload_modules
import compas
compas.PRECISION = ".3f"

gh_dir = os.path.dirname(ghenv.Component.OnPingDocument().FilePath)
sys.path.append(gh_dir)

import tree_builder
import nodegraph
import importlib

importlib.reload(nodegraph)
importlib.reload(tree_builder)


from tree_builder import build_tree_graph


# CONSTANTS #
div_x = 8
div_y = 6
num_levels = 4

inset_edge = 0.8
inset_interior = 0.7

# Build the graph (all logic is in tree_builder.py)
ng = build_tree_graph(
    boundary=boundary,
    supports=supports,
    roof_brep=roof_brep,
    div_x=div_x if div_x else 8,
    div_y=div_y if div_y else 6,
    num_levels=num_levels if num_levels else 4,
    z_steps=z_steps,
    inset_edge=inset_edge if inset_edge else 0.5,
    inset_interior=inset_interior if inset_interior else 0.4,
    reach_tol=0.05,
    debug=True
)

# Outputs
all_edges = ng.edge_lines()
graph = ng
all_nodes = ng.node_points()
node_keys = list(ng.nodes())
# ---------- end python_3_script ----------
compas_draw = COMPASDraw(cg=python_3_script.all_edges)  # -> rg
#   port cg: The COMPAS geometry or datastructure to be drawn.
#   port rg: The Rhino geometry object.
# ---------- compas_draw: Python ----------
# r: compas>=2.14.1
"""
Draws COMPAS geometry in Grasshopper.
"""

from typing import Any

import Grasshopper

from compas.scene import SceneObject


class CompasToRhinoGeometry(Grasshopper.Kernel.GH_ScriptInstance):
    def RunScript(self, cg):
        if not cg:
            return None

        return SceneObject(item=cg).draw()
# ---------- end compas_draw ----------
compas_draw_2 = COMPASDraw(cg=python_3_script.all_nodes)  # -> rg; same code as compas_draw
python_3_script_2 = Python3Script(graph=python_3_script.graph)  # -> out, edges, nodes, idx, node_graph, a, b, c
# ---------- python_3_script_2: Python ----------
from copy import deepcopy
import os
import sys

gh_dir = os.path.dirname(ghenv.Component.OnPingDocument().FilePath)
if gh_dir not in sys.path:
    sys.path.insert(0, gh_dir)

ng = deepcopy(graph)

# Delete nodes
for node_id in [288, 289]:
    if ng.has_node(node_id):
        ng.delete_node(node_id)

# Add new elements
target_pairs = [
    [286, 274, 275, True], [287, 276, 277, True], [290, 278, 279, True], [291, 280, 281, True],
    [286, 270, 271, False], [287, 272, 273, False], [290, 282, 283, False], [291, 284, 285, False],
    [246, 44, 81, False], [246, 48, 87, False], [248, 54, 91, False], [248, 58, 97, False],
    [258, 124, 161, False], [258, 128, 167, False], [260, 134, 171, False], [260, 138, 177, False],
    [249, 64, 101, False], [249, 68, 107, False], [251, 74, 111, False], [251, 78, 117, False],
    [261, 144, 181, False], [261, 148, 187, False], [263, 154, 191, False], [263, 158, 197, False],
    [286, 246], [287, 249], [290, 258], [291, 261],
    [286, 248], [287, 251], [290, 260], [291, 263],
    [296, 241], [297, 244], [298, 265], [299, 268],
    [296, 247], [297, 250], [298, 259], [299, 262],
    [296, 270], [297, 272], [298, 282], [299, 284],
    [296, 271], [297, 273], [298, 283], [299, 285],
]

ng.add_segments(target_pairs)


edges = ng.edge_lines_by_group(0) + ng.edge_lines_by_group(1)
nodes = ng.node_points()
idx = list(ng.nodes())
node_graph = ng

a = ng.points_by_mobility("fixed")     # supports + inset corners
b = ng.points_by_mobility("z_free")    # apex nodes
c = ng.points_by_mobility("yz_free")  # added via add_segment
# ---------- end python_3_script_2 ----------

swatch = ColourSwatch(SwatchColor=RGB(51, 56, 66))
text_tag = TextTag(Location=compas_draw_2, Text=python_3_script.node_keys, Colour=swatch)
dot_display = DotDisplay(Point=compas_draw_2, Colour=swatch, Size=Slider(0.1, range=0..0.1))

custom_preview_lineweights = CustomPreviewLineweights(
    Geometry=compas_draw,
    Shader=ColourSwatch(SwatchColor=RGB(144, 209, 232)),
    Thickness=Slider(4, range=0..10),
    Absolute=False)

# ----
# Transform points
brep_2 = Brep(<brep referenced from the Rhino model>)
python_3_script_3 = Python3Script(graph=python_3_script_2.node_graph, interior_brep=brep_2, move=Toggle(True), sub_iterations=Slider(5, range=0..10))  # -> out, edges, nodes, idx, node_graph, a, b, c, port, moved_points; inputs interior_brep: Brep, sub_iterations: Int32
# ---------- python_3_script_3: Python ----------
import os, sys, importlib
gh_dir = os.path.dirname(ghenv.Component.OnPingDocument().FilePath)
if gh_dir not in sys.path:
    sys.path.insert(0, gh_dir)

### -----------------------------
## IMPORT
### -----------------------------
import edge_classifier
import transformer
import nodegraph

importlib.reload(edge_classifier)
importlib.reload(transformer)
importlib.reload(nodegraph)

from edge_classifier import classify_single_segment
from transformer import edge_in_brep
from copy import deepcopy
from compas.geometry import Vector, Line, Point, centroid_points

### -----------------------------
## INITIALIZATION
### -----------------------------
ng = deepcopy(graph)

### -----------------------------
## EXECUTION
### -----------------------------
if move:
    intersecting_edges, is_clear, moved_points, pt = edge_in_brep(ng, interior_brep, sub_iterations=sub_iterations, debug=True)

target_pairs = [[298, 290], [296, 286], [297, 287], [299, 291]]
movement_data = [[graph.node_attribute(pair[0], "point"), ng.edge_line(pair).vector, pair[0]] for pair in target_pairs]
move = [ng.node_attribute(data[2], "point", data[0] + data[1]/3) for data in movement_data]


### -----------------------------
## OUTPUTS
### -----------------------------
edges = ng.edge_lines_by_group(0) + ng.edge_lines_by_group(1)
nodes = ng.node_points()
idx = list(ng.nodes())
node_graph = ng

a = ng.points_by_mobility("fixed")     # supports + inset corners
b = ng.points_by_mobility("z_free")    # apex nodes
c = ng.points_by_mobility("yz_free")  # added via add_segment

### -----------------------------
## PRINT
### -----------------------------
# print(is_clear)
# ---------- end python_3_script_3 ----------

brep_3 = Brep(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)

compas_draw_3 = COMPASDraw(cg=python_3_script_3.moved_points)  # -> rg; same code as compas_draw
dot_display_2 = DotDisplay(Point=compas_draw_3, Colour=ColourSwatch(SwatchColor=RGB(255, 255, 255)), Size=Slider(0.2, range=-0.5..0.5))

# ----
# Preview segments
number_slider = Slider(1, range=0..15)
python_3_script_4 = Python3Script(graph=python_3_script_3.node_graph, segment_id=number_slider)  # -> out, primary, secondary, subgraph; inputs segment_id: Int32
# ---------- python_3_script_4: Python ----------
import os, sys, importlib
gh_dir = os.path.dirname(ghenv.Component.OnPingDocument().FilePath)
if gh_dir not in sys.path:
    sys.path.insert(0, gh_dir)

import edge_classifier
import config

importlib.reload(edge_classifier)
importlib.reload(config)

from edge_classifier import classify_single_segment

result = classify_single_segment(graph, segment_index = segment_id,parallel_tol=None, near_threshold=None)

primary = result["primary_lines"]
secondary = result["secondary_lines"]
subgraph = result["subgraph"]
# ---------- end python_3_script_4 ----------
compas_draw_4 = COMPASDraw(cg=python_3_script_4.secondary)  # -> rg; same code as compas_draw
compas_draw_5 = COMPASDraw(cg=python_3_script_4.primary)  # -> rg; same code as compas_draw
custom_preview_lineweights_2 = CustomPreviewLineweights(Geometry=compas_draw_4, Shader=ColourSwatch(SwatchColor=RGB(50, 143, 103)), Thickness="5", Absolute=False)
custom_preview_lineweights_3 = CustomPreviewLineweights(Geometry=compas_draw_5, Shader=ColourSwatch(SwatchColor=RGB(137, 50, 143)), Thickness="20", Absolute=False)

# ----
# Preview nodes
# fixed
# z-free
# yz-free
compas_draw_6 = COMPASDraw(cg=python_3_script_3.edges)  # -> rg; same code as compas_draw
compas_draw_7 = COMPASDraw(cg=python_3_script_3.nodes)  # -> rg; same code as compas_draw
text_tag_2 = TextTag(Location=compas_draw_7, Text=python_3_script_3.idx, Colour=ColourSwatch(SwatchColor=RGB(23, 64, 15)))
compas_draw_8 = COMPASDraw(cg=python_3_script_3.c)  # -> rg; same code as compas_draw
compas_draw_9 = COMPASDraw(cg=python_3_script_3.b)  # -> rg; same code as compas_draw
compas_draw_10 = COMPASDraw(cg=python_3_script_3.a)  # -> rg; same code as compas_draw
dot_display_3 = DotDisplay(Point=compas_draw_8, Colour=ColourSwatch(SwatchColor=RGB(173, 201, 107)), Size=Slider(0.1, range=0..0.1))
dot_display_4 = DotDisplay(Point=compas_draw_9, Colour=ColourSwatch(SwatchColor=RGB(107, 201, 160)), Size=Slider(0.1, range=0..0.1))
dot_display_5 = DotDisplay(Point=compas_draw_10, Colour=ColourSwatch(SwatchColor=RGB(201, 107, 107)), Size=Slider(0.1, range=0..0.1))
