# Grasshopper definition timber_model.ghx (Grasshopper 1.0.8)
# plug-ins: Human

py3 = Python3Script()  # -> out, line_model
# ---------- py3: Python ----------
from compas.data import json_load

import os, sys, importlib

gh_dir = os.path.dirname(ghenv.Component.OnPingDocument().FilePath)
gh_par = os.path.dirname(gh_dir)
file_path = os.path.join(gh_par, "line_model","data", "260512_v3_shifted_lines.json")

print(file_path)

line_model = json_load(file_path)
# ---------- end py3 ----------

# ---- group: Graph Attributes
sort_graph_attributes = Python3Script(graph=py3.line_model)  # -> out, main_primary, primary, secondary, tertiary, shoes, plates, cut_planes, models
# ---------- sort_graph_attributes: Python ----------
import os, sys, importlib

gh_dir = os.path.dirname(ghenv.Component.OnPingDocument().FilePath)
if gh_dir not in sys.path:
    sys.path.insert(0, gh_dir)

import timber_helpers
importlib.reload(timber_helpers)

from timber_helpers import orient_polyline_to_world_z

from compas.geometry import Line, Point
from compas.scene import Scene
from copy import deepcopy

from compas_timber.model import TimberModel
from compas_timber.elements import Beam, Plate
from compas.tolerance import Tolerance

#initialise scene object
scene = Scene()

# ============================================================
# Call attributes from graph
# ============================================================

from copy import deepcopy
ng = deepcopy(graph)

main_primary = []
primary = []
secondary = []
tertiary = []
shoes = []
models = []

cut_planes = []
plates = []

groups = [ng.edge_attribute(e,"group") for e in ng.edges()]

#call node attributes from support nodes (planes and polylines)
for node in ng.nodes():
    #cutting plane for footing
    if ng.node_attribute(node, "cut_plane") is not None:
        cut_plane = ng.node_attribute(node, "cut_plane")
        group = ng.node_attribute(node, "group")
        cut_plane.normal = cut_plane.normal * -1
        cut_planes.insert(group, cut_plane)

        outline = ng.node_attribute(node, "clt_plate")
        sorted_outline, local_z = orient_polyline_to_world_z(outline)
        g = ng.node_attribute(node, "group")
        if g == 0 or g == 3:
            plate = Plate.from_outline_thickness(
                sorted_outline,
                thickness = 0.1,
                vector = local_z.normal *-1
            )
            plates.insert(group, plate)
        elif g == 1 or g == 2:
            plate = Plate.from_outline_thickness(
                sorted_outline,
                thickness = 0.1,
                vector = local_z.normal
            )
            plates.insert(group, plate)
    
#call edge attributes from all edges(lines and attributes)
for e in ng.edges():
    ln = ng.edge_attribute(e, "shifted_line")
    h = ng.edge_attribute(e, "hierarchy")

for group, number in enumerate (range(max(groups)+1)):  #iterate through all models
    model = TimberModel(Tolerance(unit="M", absolute="0.001"))
    beams = []

    clt_plate = plates[group]                           # clt plate
    clt_plate_frame = clt_plate.frame

    for e in ng.edges():
        #extract attributes
        h = ng.edge_attribute(e, "hierarchy")           # classification
        l = ng.edge_attribute(e, "level")               # level
        g = ng.edge_attribute(e, "group")               # group
        ln_width = ng.edge_attribute(e, "width")        # width
        ln_height = ng.edge_attribute(e, "height")      # height
        mj = ng.edge_attribute(e,"middle_joint")        # middle joint?
        print (mj)

        if group == g:                                  # iterate through groups
            ln = ng.edge_attribute(e, "shifted_line")   # shifted geometry

            if h == "main_primary":                     # visualise lines via .gh outputs
                main_primary.append(ln)
            elif h == "primary":
                primary.append(ln)
            elif h == "secondary":
                secondary.append(ln)
            elif h == "tertiary":
                tertiary.append(ln)
            elif h == "shoe":
                shoes.append(ln)
            if ln is None:
                continue

            #initiate beam element
            if h == "shoe":                             # align shoe to clt frame
                beam = Beam.from_centerline(
                centerline = ln,
                width = ln_width,
                height = ln_height,
                # z_vector = clt_plate_frame.normal
                )

            else:                                       # default beams aligned to world Z
                beam = Beam.from_centerline(
                centerline = ln,
                width = ln_width,
                height = ln_height
                )                

            #assign attributes to beam
            beam.name = h
            beam.attributes["hierarchy"] = h
            beam.attributes["edge"] = e
            beam.attributes["group"] = g
            beam.attributes["level"] = l
            beam.attributes["middle_joint"] = mj
            beams.append(beam)

    for beam in beams:                                  # add all elements to model
        model.add_element(beam)
    model.add_element(clt_plate)
    models.append(model)

plates = [plate.geometry for plate in plates]
# ---------- end sort_graph_attributes ----------

# ----
panel = Panel(sort_graph_attributes.models)
py3_2 = Python3Script(unload=Button())
# ---------- py3_2: Python ----------
from compas_rhino import unload_modules
import compas_timber

if unload:
    unload_modules("compas_timber")
# ---------- end py3_2 ----------
draw = COMPASDraw(cg=sort_graph_attributes.main_primary)  # -> rg
#   port cg: The COMPAS geometry or datastructure to be drawn.
#   port rg: The Rhino geometry object.
# ---------- draw: Python ----------
# r: compas>=2.14.1
"""
Draws COMPAS geometry in Grasshopper.
"""

from typing import Any

import Grasshopper

from compas.scene import SceneObject


class CompasToRhinoGeometry(Grasshopper.Kernel.GH_ScriptInstance):
    def RunScript(self, cg):
        if not cg:
            return None

        return SceneObject(item=cg).draw()
# ---------- end draw ----------
draw_2 = COMPASDraw(cg=sort_graph_attributes.secondary)  # -> rg; same code as draw
draw_3 = COMPASDraw(cg=sort_graph_attributes.shoes)  # -> rg; same code as draw
draw_4 = COMPASDraw(cg=sort_graph_attributes.primary)  # -> rg; same code as draw
draw_5 = COMPASDraw(cg=sort_graph_attributes.tertiary)  # -> rg; same code as draw
draw_6 = COMPASDraw(cg=sort_graph_attributes.plates)  # -> rg; same code as draw

# ---- group: Visualise
entwine = Entwine(Branch00=draw, Branch01=draw_4, Branch02=draw_2, Branch03=draw_5, Branch04=draw_3, FlattenInputs=True)
merge = Merge(Data1="main_primary", Data2="primary", Data3="secondary", Data4="tertiary", Data5="shoes")
merge_2 = Merge(
    Data1=ColourSwatch(SwatchColor=RGB(255, 0, 0)),
    Data2=ColourSwatch(SwatchColor=RGB(149, 0, 255)),
    Data3=ColourSwatch(SwatchColor=RGB(0, 183, 255)),
    Data4=ColourSwatch(SwatchColor=RGB(41, 189, 0)),
    Data5=ColourSwatch(SwatchColor=RGB(255, 119, 0)))
midpt = CurveMiddle(Curve=entwine)
previewlw = CustomPreviewLineweights(Geometry=entwine, Shader=graft(merge_2), Thickness="2", Absolute=False)
tag = TextTag(Location=midpt, Text=graft(merge), Colour=graft(merge_2))

# ----
timber_model = Python3Script(models=sort_graph_attributes.models, model_count=Slider(4, range=1..4))  # -> out, timber_models; inputs models: list, model_count: Int32
# ---------- timber_model: Python ----------
import os, sys, importlib

gh_dir = os.path.dirname(ghenv.Component.OnPingDocument().FilePath)
if gh_dir not in sys.path:
    sys.path.insert(0, gh_dir)

import timber_helpers
importlib.reload(timber_helpers)

from timber_helpers import is_planar, orient_polyline_to_world_z

from collections import Counter

from compas.scene import Scene
from compas_rhino.conversions import line_to_compas, polyline_to_compas, plane_to_compas
from compas.tolerance import Tolerance, TOL
from compas.geometry import Frame, Vector, Point, angle_vectors, centroid_points, Line, intersection_segment_plane

from compas_timber.model import TimberModel
from compas_timber.elements import Beam, Plate
from compas_timber.analyzers import TripletAnalyzer
from compas_timber.connections import JointTopology, TMultiStepJoint, TStepJoint, LMiterJoint, TBirdsmouthJoint, XLapJoint, KBirdsmouthJoint, TButtJoint, TLapJoint

#initialise scene object
scene = Scene()

# ============================================================
# Process Jointery
# ============================================================

models = models[0:model_count]

distances = []
max_distance = 0.055
timber_models = []

#reset beams and features
for i, model in enumerate (models):
    model = model.copy()
    for beam in model.beams:
        beam.reset_computed_properties()

    #compute line network
    model.connect_adjacent_beams(max_distance)

    max_offset = max(candidate.distance for candidate in model.joint_candidates)

    for c in model.joint_candidates:
        distances.append(c.distance)

    #handle non-pair joints (in this case a 3-way connection using TripletAnalyzer)
    analyzer = TripletAnalyzer(model, max_offset/2)
    clusters = analyzer.find()

    for cluster in clusters:
        if cluster.topology == JointTopology.TOPO_K:
            #keep track of the amount of elements per type
            counts = Counter(e.attributes["hierarchy"] for e in cluster.elements)
            if counts["secondary"] == 2 and counts["tertiary"] == 1: #skip this joint
                continue

            #define the order of the elements to be passed to the joint
            order = {"main_primary": 0, "primary": 1, "secondary": 2}
            if counts["main_primary"] == 2 and counts["primary"] == 1:
                order = {"primary": 0, "main_primary": 1, "secondary": 2} #override the order just for this condition
            reordered_elements =  sorted(cluster.elements, key=lambda e: order.get(e.attributes["hierarchy"], 99))

            if len(reordered_elements) != 3:
                raise ValueError(f"Something went wrong with the analyzer. There should be always 3 elements, got: {len(reordered_elements)}")

            #promote cluster
            kbj = KBirdsmouthJoint.promote_cluster(model, cluster, reordered_elements=reordered_elements, mill_depth=0.01)

    #handle all pair joints
    for candidate in model.joint_candidates:
        beam_a, beam_b = candidate.elements             #parallel check with beam.attributes
        if candidate.is_promoted == False:              #all joints that are not k-topology

            """CLT shoe to Top Beam"""
            if candidate.topology == JointTopology.TOPO_T and is_planar(candidate.element_a, candidate.element_b) == True:
                if beam_b.name == 'shoe':
                    t_step_joint = TStepJoint.create(model, candidate.element_a, candidate.element_b, 
                    step_shape= "double"
                    )

                    """T - Multi Step Joint"""
                elif beam_a.attributes["middle_joint"] == True:
                    t_lap_joint = TLapJoint.create(model, candidate.element_a, candidate.element_b)

                else:
                    if angle_vectors(candidate.element_a.centerline.direction, candidate.element_b.centerline.direction, 
                    deg=True) < 50:
                        step_shape = "heel"
                    else:
                        step_shape = "step"
                    t_step_joint = TMultiStepJoint.create(model, candidate.element_a, candidate.element_b, 
                    step_shape = step_shape,
                    step_depth = .020,
                    riser_angle = 90
                    )

                """T - Non-Planar Step Joint"""
            elif candidate.topology == JointTopology.TOPO_T and is_planar(candidate.element_a, candidate.element_b) == False:
                t_butt_joint = TButtJoint.create(model, candidate.element_a, candidate.element_b)
                # t_np_step_joint = TMultiStepJoint.create(model, candidate.element_a, candidate.element_b,
                # do_refine_cut=True,
                # step_depth = .020,
                # riser_angle = 90
                # )

                """L Mitre Joint"""
            elif candidate.topology==JointTopology.TOPO_L:
                l_miter_joint = LMiterJoint.create(model, candidate.element_a, candidate.element_b, 
                cutoff = False
                )

                """X Lap Joint"""
            elif candidate.topology == JointTopology.TOPO_X:
                x_lap_joint = XLapJoint.create(model, candidate.element_a, candidate.element_b
                )

            else:
                continue

    timber_models.append(model)
# ---------- end timber_model ----------
panel_2 = Panel(timber_model.timber_models)
showjointtypes = CTShowJointTypes()  # disabled
#   port model: Model object.
# ---------- showjointtypes: Python ----------
"""Shows the names of the defined Joints."""
# env: C:\Users\kapso\OneDrive\Documents\GitHub\timber_design\src
# r: compas_timber>=0.16.2
# flake8: noqa
import Grasshopper
import System
from compas_rhino.conversions import point_to_rhino

from compas_timber.utils import intersection_line_line_param
from timber_design.ghpython.ghcomponent_helpers import item_input_valid_cpython


class ShowJointTypes(Grasshopper.Kernel.GH_ScriptInstance):
    def RunScript(self, model):
        self.pt = []
        self.txt = []

        if not item_input_valid_cpython(ghenv, model, "model"):
            return

        for joint in model.joints:
            line_a, line_b = joint.elements[0].centerline, joint.elements[1].centerline
            [p1, _], [p2, _] = intersection_line_line_param(line_a, line_b, float("inf"), False, 1e-3)
            p1 = point_to_rhino(p1)
            p2 = point_to_rhino(p2)

            self.pt.append((p2 + p1) / 2)
            self.txt.append(joint.__class__.__name__)

    def DrawViewportWires(self, arg):
        if ghenv.Component.Locked:
            return
        col = System.Drawing.Color.FromArgb(255, 0, 0, 0)
        # https://developer.rhino3d.com/api/RhinoCommon/html/M_Rhino_Display_DisplayPipeline_Draw2dText_5.htm
        for p, t in zip(self.pt, self.txt):
            arg.Display.Draw2dText(t, col, p, True, 12, "Verdana")
# ---------- end showjointtypes ----------
displayjointnames = Python3Script(model=timber_model.timber_models)
# ---------- displayjointnames: Python ----------
import Grasshopper
import System

from compas_rhino.conversions import point_to_rhino

from compas_timber.utils import intersection_line_line_param

class ShowJointTypes(Grasshopper.Kernel.GH_ScriptInstance):
    def RunScript(self, model):
        self.pt = []
        self.txt = []

        for joint in model.joints:
            line_a, line_b = joint.elements[0].centerline, joint.elements[1].centerline
            [p1, _], [p2, _] = intersection_line_line_param(line_a, line_b, float("inf"), False, 1e-3)
            p1 = point_to_rhino(p1)
            p2 = point_to_rhino(p2)
            
            self.pt.append((p2 + p1)/2)
            self.txt.append(joint.__class__.__name__)
    
    def DrawViewportWires(self, arg):
        if ghenv.Component.Locked:
            return
        col = System.Drawing.Color.FromArgb(255, 0, 0, 0)
        # https://developer.rhino3d.com/api/RhinoCommon/html/M_Rhino_Display_DisplayPipeline_Draw2dText_5.htm
        for p, t in zip(self.pt, self.txt):
            arg.Display.Draw2dText(t, col, p, True, 15, "Verdana")
# ---------- end displayjointnames ----------
process_joinery = Python3Script(
    timber_models=timber_model.timber_models,
    cut_planes=sort_graph_attributes.cut_planes,
    process=Toggle(True),
    vizualize=Toggle(True))  # -> out, timber_models, geo, debug_info; inputs timber_models: list, cut_planes: list, process: Boolean, vizualize: Boolean
# ---------- process_joinery: Python ----------
# from timber_design.workflow import DebugInfomation
# debug_info = DebugInfomation()

from compas.scene import Scene

from compas_timber.model import TimberModel
from compas_timber.elements import Beam, Plate
from compas_timber.fabrication import JackRafterCut

from compas.geometry import intersection_segment_plane

scene = Scene()

max_level = [beam.attributes["level"] for beam in timber_models[0].beams]

if process:
    for i, model in enumerate (timber_models):
        model.process_joinery()

        for beam in model.beams:
            beam.reset_computed_properties()

            if beam.attributes["hierarchy"] == "primary" or beam.attributes["hierarchy"] == "main_primary" and beam.attributes["level"] == max(max_level):
                    cutting_plane = cut_planes[i]
                    intersection = intersection_segment_plane(beam.centerline, cutting_plane, tol=None)
                    if intersection is not None:
                        jackrafter = JackRafterCut.from_plane_and_beam(cutting_plane, beam)
                        beam.add_feature(jackrafter)
                        # btlxprocessing, is joinery = False (to allow joints to be serialised)

        # drill_line = line_to_compas(drill_line)
        # for i, beam in enumerate(model.beams):
        #     if i == 0:
        #         drill_feature = Drilling.from_line_and_element(drill_line, beam, diameter=10)
        #         beam.add_features(drill_feature)
        #         scene.add(beam.geometry)

    # bje = model.process_joinery()
#     if bje:
#         debug_info.add_joint_error(bje)

if vizualize:
    for model in timber_models:
        for beam in model.beams:
            scene.add(beam.geometry)
            # if beam.debug_info:
            #     for error in beam.debug_info:
            #         debug_info.add_feature_error(error)
        for plate in model.plates:
            scene.add(plate.geometry)

geo = scene.draw()
# ---------- end process_joinery ----------
panel_3 = Panel(process_joinery.timber_models)
geometry = Geometry(process_joinery.geo)
preview = CustomPreview(Geometry=geometry, Material=ColourSwatch(SwatchColor=RGBA(156, 115, 115, 145)))
featureerrors = CTShowFeatureErrors(debug_info=process_joinery.debug_info, i=Slider(0, range=0..100))  # -> Info, Geometry
#   port debug_info: DebugInformation object containing feature errors.
#   port i: Index of the feature error to show. This index wraps around the number of errors.
#   port Info: Information about the selected feature error.
#   port Geometry: Geometry related to the selected feature error.
# ---------- featureerrors: Python ----------
"""Shows information useful for debugging feature application errors."""
# env: C:\Users\kapso\OneDrive\Documents\GitHub\timber_design\src
# r: compas_timber>=0.16.2
# flake8: noqa
import Grasshopper

from compas.scene import SceneObject
from timber_design.ghpython.ghcomponent_helpers import item_input_valid_cpython


class ShowFeatureErrors(Grasshopper.Kernel.GH_ScriptInstance):
    def RunScript(self, debug_info, i):
        if not item_input_valid_cpython(ghenv, i, "i"):
            i = 0
        if not item_input_valid_cpython(ghenv, debug_info, "DebugInfo"):
            return
        if not debug_info.feature_errors:
            ghenv.Component.AddRuntimeMessage(Grasshopper.Kernel.GH_RuntimeMessageLevel.Warning, "No feature errors found in input parameter 'DebugInfo'")
            return
        feature_errors = debug_info.feature_errors
        i = int(i) % len(feature_errors)
        error = feature_errors[i]

        geometries = [error.feature_geometry, error.element_geometry]
        geometries = flatten(geometries)
        geo_objs = [SceneObject(item=geo) for geo in geometries]
        output = []
        for obj in geo_objs:
            output.extend(obj.draw())

        return error.message, output


def flatten(lst):
    if not lst:
        return lst
    if isinstance(lst[0], list):
        return flatten(lst[0]) + flatten(lst[1:])
    return lst[:1] + flatten(lst[1:])
# ---------- end featureerrors ----------
py3_3 = Python3Script(models=process_joinery.timber_models, save=Button())  # inputs models: list
# ---------- py3_3: Python ----------
import os, sys, importlib
from compas.data import json_dump

gh_dir = os.path.dirname(ghenv.Component.OnPingDocument().FilePath)
gh_par = os.path.dirname(gh_dir)
file_path = os.path.join(gh_par, "timber_design","data")

if save:
    for i, m in enumerate(models):
        """Serialize models to .JSON"""
        output_path = os.path.join(file_path, f"12_05_timber_model_v4_{i}.json")
        m.to_json(output_path, pretty=True)
        print(f"Model written to {output_path}")
# ---------- end py3_3 ----------
file_path = FilePath("/Users/minghip/Documents/Github/llhil-t2-fabrication/design/timber_design/data/12_05_timber_model_v4_1.json")
file_path_2 = FilePath("/Users/minghip/Documents/Github/llhil-t2-fabrication/design/timber_design/data/12_05_timber_model_v4_3.json")
file_path_3 = FilePath("/Users/minghip/Documents/Github/llhil-t2-fabrication/design/timber_design/data/12_05_timber_model_v4_0.json")
file_path_4 = FilePath("/Users/minghip/Documents/Github/llhil-t2-fabrication/design/timber_design/data/12_05_timber_model_v4_2.json")
python_3_script = Python3Script(y=[file_path_3, file_path, file_path_4, file_path_2])  # -> out, a, b; inputs y: String; disabled
# ---------- python_3_script: Python ----------
from compas.data import json_load
from compas_timber.model import TimberModel
from compas.scene import Scene

scene = Scene()

timber_model = json_load(y)
timber_model.process_joinery()
a = timber_model

for beam in a.beams:
    scene.add(beam.geometry)

for plate in a.plates:
    scene.add(plate.geometry)

b = scene.draw()
# ---------- end python_3_script ----------
panel_4 = Panel(python_3_script.a)
